# Dynamo graph MM - Python - Family - Add Shared Parameters.dyn (Dynamo 2.3.1.11775)

# group: Type Parameters and User Inputs
file_path_to_shared_parameter = Filename("S:\VDC\11-WIP - Family\WIP - VDC Shared Parameters\HEC_Shared Parameters.txt")  # "File Path to Shared Parameter File"; graph input
readText = FileSystem.ReadText(file=file_path_to_shared_parameter)
type_parameter_name_s = StringInput("HEC_Host Element, HEC_Sub Element")  # graph input
host_true_sub_false = BoolSelector(false)
delimeter_include_space_if = StringInput(", ")  # "Delimeter(include space if exists)"

group_name = StringInput("WBS")  # graph input

# group: Instance Parameters
instance_parameter_name_s = StringInput("HEC_Work Package Number, HEC_Trade Code, HEC_Area")  # graph input

add_shared_parameter_to_family = Python(IN[0]=readText, IN[1]=group_name, IN[2]=type_parameter_name_s, IN[3]=instance_parameter_name_s, IN[4]=host_true_sub_false, IN[5]=delimeter_include_space_if)
# ---------- add_shared_parameter_to_family.python (87 lines) ----------
import clr
clr.AddReference('RevitAPI')
from Autodesk.Revit.DB import*

clr.AddReference('RevitServices')
from RevitServices.Persistence import DocumentManager
from RevitServices.Transactions import TransactionManager

doc = DocumentManager.Instance.CurrentDBDocument
uiapp = DocumentManager.Instance.CurrentUIApplication
app = uiapp.Application

#Inputs
spfile = IN[0] 
group_name = IN[1]
param_name = IN[2] 
param_name2 = IN[3]
subHost = IN[4]
delim = IN[5]

#Lists
result = []

#ExternalDefinition
def defFile(file, group, param) :
	file = app.OpenSharedParameterFile()
	defGroup = file.Groups.get_Item(group)
	return defGroup.Definitions.get_Item(param)
	
#Start Functions	
pName = param_name.split(delim)
pName2 = param_name2.split(delim)	


for pn in pName:
	try:
		TransactionManager.Instance.EnsureInTransaction(doc)
		eDef = defFile(spfile, group_name, pn)
		param = doc.FamilyManager.AddParameter(eDef, BuiltInParameterGroup.PG_IDENTITY_DATA, False)
		result.append('Success')
		TransactionManager.Instance.ForceCloseTransaction()
		if subHost == True:
			param.Definition.Name
			if param.Definition.Name == "HEC_Host Element":
				TransactionManager.Instance.EnsureInTransaction(doc)
				doc.FamilyManager.SetFormula(param, str("1=1"))
				TransactionManager.Instance.TransactionTaskDone()
				result.append("Host True")
			elif param.Definition.Name == "HEC_Sub Element":
				TransactionManager.Instance.EnsureInTransaction(doc)
				doc.FamilyManager.SetFormula(param, str("1=0"))
				TransactionManager.Instance.TransactionTaskDone()
				result.append("Sub False")
		else:
			if param.Definition.Name == "HEC_Host Element":
				TransactionManager.Instance.EnsureInTransaction(doc)
				doc.FamilyManager.SetFormula(param, str("1=0"))
				TransactionManager.Instance.TransactionTaskDone()
				result.append("Host False")
			elif param.Definition.Name == "HEC_Sub Element":
				TransactionManager.Instance.EnsureInTransaction(doc)
				doc.FamilyManager.SetFormula(param, str("1=1"))
				TransactionManager.Instance.TransactionTaskDone()
				result.append("Sub True")

	except:
		result.append('Failed')
		TransactionManager.Instance.ForceCloseTransaction()
		
		
		
for pN in pName2:
	try :
		TransactionManager.Instance.EnsureInTransaction(doc)
		eDef2 = defFile(spfile, group_name, pN)
		doc.FamilyManager.AddParameter(eDef2, BuiltInParameterGroup.PG_DATA, True)
		result.append('Success')
		TransactionManager.Instance.ForceCloseTransaction()
	except :
		result.append('Failed')
		TransactionManager.Instance.ForceCloseTransaction()
	

		
		
		
OUT = result
# ----------------------------------------
