# Dynamo graph MM - Python - Set Parameters if value contained in CSV.dyn (Dynamo 2.0.4.12684)

csv_file_path = Filename("..\..\..\..\Downloads\MM - CSV to Parameter Test.csv")  # graph input
column_letter_for_parameter_name = StringInput("A")  # "Column Letter for Parameter Name(only works on A-Z):"; graph input
ignore_case = BoolSelector(false)
python_read_csv_find_elements = Python(IN[0]=csv_file_path, IN[1]=column_letter_for_parameter_name, IN[2]=ignore_case)  # "Python - Read CSV, find Elements with Param Name/Value Pair, and push values to remainder of Param Name/Value pairs in CSV"
# ---------- python_read_csv_find_elements.python (180 lines) ----------
#portion of script covering find element containing parameter value taken from MEPover FilterStringEquals node.

import clr
import sys
pyPath = r"C:\Program Files (x86)\IronPython 2.7\Lib"
sys.path.append(pyPath)
import os
import System 
import System.Collections
#Access to Revit Document
clr.AddReference("RevitServices")
import RevitServices
#To Get Doc, UI and Application Objects
from RevitServices.Persistence import DocumentManager
doc = DocumentManager.Instance.CurrentDBDocument
uidoc = DocumentManager.Instance.CurrentUIDocument
app = DocumentManager.Instance.CurrentUIApplication.Application
#Needed to make any changes in Revit
from RevitServices.Transactions import TransactionManager
clr.AddReference("RevitNodes")
import StringIO
from System.IO import FileInfo
import Revit
clr.ImportExtensions(Revit.Elements)
clr.ImportExtensions(Revit.GeometryConversion)
clr.AddReference("RevitAPI")
import Autodesk
from Autodesk.Revit.DB import *;
clr.AddReference("RevitAPIUI")
from Autodesk.Revit.UI import *
from System.Collections.Generic import List
import csv
from System.IO import FileInfo

#Get CSV Path, Param Row Letter, ParamVal Column Number 
filePath = IN[0]
paramName = IN[1].lower()
pNToInt = ord(paramName)-97#lowecase a starts at 97 in ASCII

#get CSV Info
with open(filePath) as csvCountFile:
	delReader = csv.reader(csvCountFile, delimiter=',')
	columns = len(next(delReader))
	data = list(delReader)
	rows = len(data)
	del delReader
	csvCountFile.close()

csvData = []
with open(filePath) as csvFile:
	csvReader = csv.reader(csvFile, delimiter=',')
	for row in csvReader:
		csvData.append(row)

i = 0
while i < rows:
	pVC	= 1 + i
	#find Elements with Value from CSV
	search = csvData[pNToInt][0]
	string = csvData[pVC][pNToInt]
	

	case = IN[2]
	bips = System.Enum.GetValues(BuiltInParameter)
	
	bm = doc.ParameterBindings
	bmlist = bm.ForwardIterator()
	paramId = None
	testout = []
	while bmlist.MoveNext():
		binddef = bmlist.Key
		testout.append(binddef.Name)
		if binddef.Name == search:
			paramId = binddef.Id
			break
	
	param = None
	if paramId == None:
		biplist = []
		for bip in bips:
			try:
				name = LabelUtils.GetLabelFor(bip)
			except:
				continue
			if name == search:
				biplist.append(bip)
	
	
	sharedparamrule = SharedParameterApplicableRule(search)
	evaluator = FilterStringEquals()
	
	parameter = None
	if paramId == None and len(biplist) == 0:
		coll = FilteredElementCollector(doc)
		sharedparams = coll.OfClass(ParameterElement)
		
		for param in sharedparams:
			name = param.GetDefinition().Name
			if name == search:
				parameter = param
		
		if parameter != None:
			ruleslist = List[FilterRule]()
			provider = ParameterValueProvider(parameter.Id)
			filterrule = FilterStringRule(provider, evaluator, string, case)
			ruleslist.Add(filterrule)
			ruleslist.Add(sharedparamrule)
			paramFilter = ElementParameterFilter(ruleslist)
			collector = FilteredElementCollector(doc)
			collector.OfClass(FamilyInstance).WherePasses(paramFilter)
			
			collector2 = FilteredElementCollector(doc)
			collector2.OfClass(HostObject).WherePasses(paramFilter)
			collector2.UnionWith(collector)
	
	elif paramId == None:
		filterList = List[ElementFilter]()
		for param in biplist:
			provider = ParameterValueProvider(ElementId(param))
			filterrule = FilterStringRule(provider, evaluator, string, case)
			paramFilter = ElementParameterFilter(filterrule)
			filterList.Add(paramFilter)
				
		orFilter = LogicalOrFilter(filterList)
		collector = FilteredElementCollector(doc)
		collector.OfClass(FamilyInstance).WherePasses(orFilter)
		
		collector2 = FilteredElementCollector(doc)
		collector2.OfClass(HostObject).WherePasses(orFilter)
		collector2.UnionWith(collector)
	else:
		ruleslist = List[FilterRule]()
		provider = ParameterValueProvider(paramId)
		filterrule = FilterStringRule(provider, evaluator, string, case)
		ruleslist.Add(filterrule)
		ruleslist.Add(sharedparamrule)
		paramFilter = ElementParameterFilter(ruleslist)
		collector = FilteredElementCollector(doc)
		collector.OfClass(FamilyInstance).WherePasses(paramFilter)
		
		collector2 = FilteredElementCollector(doc)
		collector2.OfClass(HostObject).WherePasses(paramFilter)
		collector2.UnionWith(collector)
	
	
	if parameter == None and paramId == None and len(biplist) == 0:
		OUT = "Does not work with non-shared family parameters"
	else:
		elements = collector2.ToElements()
	
	elemsChanged = []
	results = [] 
	import traceback 
	for e in elements: 
		TransactionManager.Instance.EnsureInTransaction(doc)
		try: 
			ii = 0  
			while ii < columns: 
				param = csvData[0][ii] 
				val = csvData[pVC][ii]
				if e.LookupParameter(param).StorageType == StorageType.Integer:
					e.LookupParameter(param).Set(int(val))
				elif e.LookupParameter(param).StorageType == StorageType.String:
					e.LookupParameter(param).Set(str(val))
				elif e.LookupParameter(param).StorageType == StorageType.Double:	
					e.LookupParameter(param).Set(float(val))	
				else:
					e.LookupParameter(param).SetValueString(val)			  
				ii+=1 
			elemsChanged.Add(e) 
			results.append("All set") 
		
		except: 
			message = traceback.format_exc() 
			elemsChanged.Add(None) 
			results.append(message) 
		TransactionManager.Instance.TransactionTaskDone()
	i += 1

OUT = csvData, search, string, elemsChanged, elements, results
# ----------------------------------------
